# Grasshopper definition Sample_1_Shape_ v_2.1.gh (Grasshopper 0.9.76)
# plug-ins: atit

# ----
# You can download FOOT PRINT.shp file for NYC here:
# 
# https://data.cityofnewyork.us/Housing-Development/Building-Footprints/tb92-6tj8
# 
# 
# 
# FOOT PRINT.shp file for San Francisco can be found here:
# 
# https://data.sfgov.org/Facilities-and-Structures/Building-Footprints-Zipped-Shapefile-Format-/jezr-5bxm
# Input .shp file path for
# the "FOOT PRINT"
foot_print = Panel("building_footprints_shape_09-13\building_0913.shp")

# ----
# You can download TAX PROPRTIES.shp file for NYC here:
# 
# http://www.nyc.gov/html/dcp/html/bytes/dwn_pluto_mappluto.shtml#mappluto
# Input .shp file path for
# the "TAX PROPERTIES"
tax_properties = Panel("MNMapPLUTO_13v1\MNMapPLUTO.shp")

# ----
# You can download POPULATION.shp file for NYC here:
# 
# (36061 is Manhattan or you can search for other Borough online-look at the name of the file we are using)
# 
# http://www2.census.gov/geo/pvs/36/
# Input .shp file path for
# the "POPULATION"
population = Panel("manhattan population\partnership_shapefiles_12v2_36061\PVS_12_v2_tabblock2010_36061.shp")

# ----
# SET TO TRUE #1
# Depending on how large the data set is, this component might take up to a few minutes to conver all the data to system.object
toggle = BooleanToggle(False)
imp_it = ImpIt(ShapefileShpPath=foot_print, Project2WGS84=False, TrueOrFalse=toggle)  # -> Shapes, Features

# ----
# SET TO TRUE #1
# Depending on how large the data set is, this component might take up to a few minutes to conver all the data to system.object
toggle_2 = BooleanToggle(False)

# ----
# SET TO TRUE #1
# Depending on how large the data set is, this component might take up to a few minutes to conver all the data to system.object
toggle_3 = BooleanToggle(False)
imp_it_2 = ImpIt(ShapefileShpPath=population, Project2WGS84=False, TrueOrFalse=toggle_3)  # -> Shapes, Features

# ----
# This component is much faster and you can quickly review the existing attributes in the data set
# INPUT
feat_it = FeatIt()  # -> GeometryType, ProjectionType, Features

# ----
# This component is much faster and you can quickly review the existing attributes in the data set
# INPUT
feat_it_2 = FeatIt()  # -> GeometryType, ProjectionType, Features

imp_it_3 = ImpIt(ShapefileShpPath=tax_properties, Project2WGS84=False, TrueOrFalse=toggle_2)  # -> Shapes, Features

# ----
# This component is much faster and you can quickly review the existing attributes in the data set
# INPUT
feat_it_3 = FeatIt()  # -> GeometryType, ProjectionType, Features

type_of_the_projection = Panel(feat_it_2.ProjectionType)
existing_attributes_in_the_data_set = Panel(feat_it_2.Features)
type_of_the_data_set = Panel(feat_it_2.GeometryType)
existing_attributes_in_the_data_set_2 = Panel(imp_it.Features)
# SAMPLE_5
existing_attributes_in_the_data_set_3 = Panel(imp_it_3.Features)
existing_attributes_in_the_data_set_4 = Panel(feat_it.Features)
type_of_the_data_set_2 = Panel(feat_it.GeometryType)
type_of_the_data_set_3 = Panel(feat_it_3.GeometryType)
type_of_the_projection_2 = Panel(feat_it_3.ProjectionType)
existing_attributes_in_the_data_set_5 = Panel(feat_it_3.Features)
existing_attributes_in_the_data_set_6 = Panel(imp_it_2.Features)
type_of_the_projection_3 = Panel(feat_it.ProjectionType)

# ----
# SAMPLE_3
# SET TO TRUE #4
toggle_4 = BooleanToggle(False)
datavis_it = DataVisIt(Shapes=imp_it.Shapes, GetValueofFeature=imp_it.Features, TrueOrFalse=toggle_4)  # -> Polygon, Polyline, Point, AttValues
panel = Panel(datavis_it.AttValues)

# ----
# Input BIN
bin_s = Panel("1086164")

# ----
# Input .shp file path for
# the "MAP PLUTO for MN"
# Input .shp file path for
# the "FOOT PRINT"
panel_2 = Panel("NYC datasets\mn_mappluto_13v1\MNMapPLUTO_13v1\MNMapPLUTO.shp")
panel_3 = Panel("NYC datasets\building_footprints_shape_09-13(1)\building_0913.shp")

# ----
# SET TO TRUE #1
# Depending on how large the data set is, this component might take up to a few minutes to conver all the data to gh shape object
toggle_5 = BooleanToggle(False)
# IMPORTANT NOTE FOR NYC: BBL(Borough Block Lot)
# BBL is a 10 digit number in NYC and it starts with the Borough number.
# 
# Manhattan Borough  #1
# Bronx  Borough  #2
# Brooklyn Borough  #3
# Queens Borough  #4
# Staten island Borough  #5
# 
# So we can filter through Boroughs in order to minimize our data. Here we can also look at BBL numbers below 20000000000 which would be all the BBLs in Manhattan.
toggle_6 = BooleanToggle(False)
imp_it_4 = ImpIt(ShapefileShpPath=panel_2, Project2WGS84=False, TrueOrFalse=toggle_5)  # -> Shapes, Features
footprint_data_set = FootprintbyBorough(ShapefileShpPath=panel_3, BoroughCode="1", Boolean=toggle_6)  # -> Shapes, Features

attribute_of_the_given_data_set = Panel(footprint_data_set.Features)
# DATA BINDING
# SAMPLE_6
attributes_of_the_given_data_set = Panel(imp_it_4.Features)

# ----
# SAMPLE_4
number_slider = Slider(6, range=0..20)
item = ListItem(List=imp_it_2.Features, Index=number_slider, Wrap=True)
panel_4 = Panel(item)

datavis_it_2 = DataVisIt(Shapes=imp_it_2.Shapes, GetValueofFeature=panel_4, TrueOrFalse=Toggle(False))  # -> Polygon, Polyline, Point, AttValues

population_per_block = Panel(datavis_it_2.AttValues)
domain = Domain(datavis_it_2.AttValues)
bnd = Bounds(Numbers=flatten(domain))
dedomain = DeconstructDomain(Domain=bnd)  # -> Start, End
gradient = Gradient(
    LowerLimit=dedomain.End,
    UpperLimit=dedomain.Start,
    Parameter=datavis_it_2.AttValues,
    stops=[0.651: RGB(0, 38, 128), 0.806: RGB(255, 0, 0), 1: RGB(255, 229, 0), 1: RGB(255, 255, 194)])

# ---- group: Some curves are not closed, reason for being orange
boundary = BoundarySurfaces(Edges=datavis_it_2.Polygon)

# ----
# Enable Preview_3
preview = CustomPreview(Geometry=boundary, Shader=gradient)

# ----
# SAMPLE_1
# SET TO TRUE #2
number_slider_2 = Slider(9, range=0..20)
# DATA QUERY + VISUALIZATION
number_slider_3 = Slider(1, range=0..20)
item_2 = ListItem(List=existing_attributes_in_the_data_set_2, Index=number_slider_2, Wrap=True)  # -> flatten(Item)
item_3 = ListItem(List=existing_attributes_in_the_data_set_2, Index=number_slider_3, Wrap=True)  # -> flatten(Item)
attribute_s = Panel(item_2)
attribute = Panel(item_3)

# ----
# Query for the data you are interested in. In this case we want to query for a specific building and it's height in order to create the geometry. You can query by BIN (Building Identification Number ).  [FltByFeat] input should be one item only. [FltByVal] can be a list. [GetValofFeat] will be the properties of the selected BIN.
datavis_it_3 = DataVisIt(
    Shapes=imp_it.Shapes,
    FilterByFeat=attribute,
    FilterByFeatureValue=bin_s,
    GetValueofFeature=attribute_s,
    TrueOrFalse=Toggle(False))  # -> Polygon, Polyline, Point, AttValues

boundary_2 = BoundarySurfaces(Edges=datavis_it_3.Polygon)
building_height = Panel(datavis_it_3.AttValues)
panel_5 = Panel(datavis_it_3.Polygon)
preview_2 = CustomPreview(Geometry=boundary_2, Shader=ColourSwatch(SwatchColor=RGB(0, 201, 67)))
num = Number(building_height)
Z = UnitZ(Factor=num)

# ---- group: BUILDING TO BE ANALYZED
extr = Extrude(Base=boundary_2, Direction=Z)

# ----
# Enable Preview_1
# Enable Preview_3
preview_3 = CustomPreview(Geometry=datavis_it.Polygon, Shader=ColourSwatch(SwatchColor=RGB(125, 115, 115)))
preview_4 = CustomPreview(Geometry=extr, Shader=ColourSwatch(SwatchColor=RGBA(118, 240, 31, 234)))

# ----
# SAMPLE_2
# SET TO TRUE #3
panel_6 = Panel("""1
9""")
item_4 = ListItem(List=existing_attributes_in_the_data_set_2, Index=panel_6, Wrap=True)  # -> flatten(Item)
attribute_s_2 = Panel(item_4)
pcen = PolygonCenter(Polyline=datavis_it_3.Polygon)  # -> CenterV, CenterE, CenterA
distance_ft = Panel("200")

# ----
# You can use "DataVis" component this way as well. In this case, it will output the entire data. Therfore, depending on the size of data, it might be slow!
# 
# In this example we are visualizing all the 5 brough of NYC
datavis_it_4 = DataVisIt(Shapes=imp_it.Shapes, GetValueofFeature=attribute_s_2, TrueOrFalse=Toggle(False))  # -> Polygon, Polyline, Point, AttValues
preview_5 = CustomPreview(Geometry=datavis_it_4.Polygon, Shader=ColourSwatch(SwatchColor=RGB(125, 115, 115)))

# ---- group: DO NOT ENABLE PREVIEW
# This might take all you
# memory if you are
# using a large data
pcen_2 = PolygonCenter(Polyline=datavis_it_4.Polygon)  # -> CenterV, CenterE, CenterA

# ----
dist = Distance(PointA=pcen.CenterA, PointB=pcen_2.CenterA)
smaller = SmallerThan(FirstNumber=dist, SecondNumber=distance_ft)  # -> SmallerThan, OrEqualTo
cull = CullPattern(List=datavis_it_4.AttValues, CullPattern=smaller.SmallerThan)
cull_2 = CullPattern(List=datavis_it_4.Polygon, CullPattern=smaller.SmallerThan)

# ---- group: List of BINs
clean = CleanTree(Tree=cull, CleanInvalid=True, CleanEmpty=True)  # -> simplify(Tree)

# ---- group: List of Polylines
clean_2 = CleanTree(Tree=cull_2, CleanInvalid=True, CleanEmpty=True)  # -> simplify(Tree)

# ----
bin_building_height = Panel(clean)
panel_7 = Panel(clean_2)
item_5 = ListItem(List=bin_building_height, Index=Slider(1, range=0..20), Wrap=True)
boundary_3 = BoundarySurfaces(Edges=clean_2)
num_2 = Number(item_5)
Z_2 = UnitZ(Factor=num_2)
pcen_3 = PolygonCenter(Polyline=clean_2)  # -> CenterV, CenterE, CenterA
item_6 = ListItem(List=bin_building_height, Index=Slider(0, range=0..20), Wrap=True)

# ---- group: BUILDING TO BE ANALYZED
extr_2 = Extrude(Base=boundary_3, Direction=Z_2)

# ----
# Enable Preview_2
tag = TextTag3D(Location=pcen_3.CenterA, Text=item_6, Size=Slider(5, range=0..20), Justification=7)
preview_6 = CustomPreview(Geometry=extr_2, Shader=ColourSwatch(SwatchColor=RGBA(66, 40, 181, 185)))

# ----
# This is "NYCVis" component  for NYC Linked data.  In this case, it will output the Number of Floors  for only zipcode 10001
# sort the buildings only 6 floors and higher
# Select the item from feature list : ZipCode
# SET TO TRUE #2
# this component does the data binding !
# Select the item from feature list : NumFloors
# Select the item from feature list : BIN
data_bind = BindTwoShapefilesDatasets(S_NYC_Taxmap=imp_it_4.Shapes, S_NYC_BldgFootprints=footprint_data_set.Shapes)
item_7 = ListItem(List=imp_it_4.Features, Index=41, Wrap=True)
item_8 = ListItem(List=imp_it_4.Features, Index=8, Wrap=True)
item_9 = ListItem(List=footprint_data_set.Features, Index=0, Wrap=True)
panel_8 = Panel(item_9)

visualizelinkeddata = VisualizeLinkedData(
    LinkedShapes=data_bind,
    Object_FilterByAtt=item_8,
    FilterAttValues="10001",
    GetAtt_Value=panel_8,
    TrueOrFalse=Toggle(False))  # -> TaxProperty, Footprints, AttValues
visualizelinkeddata_2 = VisualizeLinkedData(
    LinkedShapes=data_bind,
    Object_FilterByAtt=item_8,
    FilterAttValues="10001",
    GetAtt_Value=item_7,
    TrueOrFalse=Toggle(False))  # -> TaxProperty, Footprints, AttValues

int = Integer(visualizelinkeddata_2.AttValues)
panel_9 = Panel(visualizelinkeddata_2.Footprints)
panel_10 = Panel(visualizelinkeddata_2.AttValues)
panel_11 = Panel(visualizelinkeddata_2.TaxProperty)
panel_12 = Panel(visualizelinkeddata.AttValues)
larger = LargerThan(FirstNumber=int, SecondNumber="6")  # -> LargerThan, OrEqualTo
cull_3 = CullPattern(List=visualizelinkeddata.AttValues, CullPattern=larger.OrEqualTo)
panel_13 = Panel(larger.OrEqualTo)
panel_14 = Panel(cull_3)
clean_3 = CleanTree(Tree=cull_3, CleanInvalid=True, CleanEmpty=Toggle(True))
flatten = FlattenTree(Tree=clean_3, Path="{0}")
cset = CreateSet(List=flatten)  # -> Set, Map
bins_of_the_buildings_are_6_floors_or_hi = Panel(cset.Set)  # "BINs of the buildings are 6 floors or higher 10001"
