# Grasshopper definition Sample_2_OSM_GeoCoder_Statistics_2.1.gh (Grasshopper 0.9.76)
# plug-ins: atit, HDTReference

# ----
# Input Address or
# Landmark name
panel = Panel("union square nyc")

# ----
# Type any address! this component return the true addesses & location (lat, long)
# 
# Can be return multiple output
address_parser = AddressParser()  # -> FormattedAdress, LatitudeLongitude

# ----
# GeoCoder
formatted_address = Panel(address_parser.FormattedAdress)
item = ListItem(List=address_parser.LatitudeLongitude, Index=0, Wrap=True)

# ----
# street view , use the location output from address parser component
# Returns Mesh on rhino canvas! Use attributes for navigation
street_view = StreetView(LatitudeLongitude=item, Width=600, Height=400, FieldOfView=90, Picth=0)

# ----
# Reverse Geocoding : Address from latitude & longitude
address_lookup = AddressLookup()

# ----
# Input Address or
# Landmark name
panel_2 = Panel("union square nyc")

address_parser_2 = AddressParser(Address=panel_2)  # -> FormattedAdress, LatitudeLongitude
num = Number(Slider(200, range=0..200))

# ----
# OSM
# Trace Open street map
osm_trace = Osm_Trace(Lat_Range=num, Long_Range=num, UTMLatLong=True)  # -> Osm_IDs, IsOsm_Bldg, Osm_Trace, KeyValue

# ----
# OSM
# OSM 3D Buildings
# Imports Open Street Map 3D buildings !
# Compare with
# http://osmbuildings.org/?lat=40.73585&lon=-73.98941&zoom=17
osm_buildings = Osm_Bldgs(Lat_Range=num, Long_Range=num)  # -> Osm_IDs, Osm_3D_bldgs, Osm_Bldg_Colours

# ---- group: BETTER VIS USE HUMAN PLUGIN
wires = BrepWireframe(Brep=osm_buildings.Osm_3D_bldgs, Density=-1)
# OSM BLDG DATA
preview = CustomPreview(Geometry=flatten(osm_buildings.Osm_3D_bldgs), Shader=flatten(osm_buildings.Osm_Bldg_Colours))
previewlw = CustomPreviewLineweights(Geometry=wires, Shader=ColourSwatch(SwatchColor=RGB(0, 0, 0)), Thickness=Slider(1, range=0..10))
previewmat = CustomPreviewMaterials(Geometry=osm_buildings.Osm_3D_bldgs, DiffuseColor=osm_buildings.Osm_Bldg_Colours)

# ----
cull = CullPattern(List=osm_trace.Osm_IDs, CullPattern=osm_trace.IsOsm_Bldg)
item_2 = ListItem(List=cull, Index=0, Wrap=True)

# ----
# Get detailed data of OSM Building
osm_bldginfo = Osm_BldgInfo(Osm_Bldg_ID=item_2)  # -> Name, Building, BuildingPart, BuildingUse, BuildingLevels, BuildingMin_level, BuildingMaterial, BuildingColor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

# ----
# COORDINATES TO STATISTIC
# Input Address or
# Landmark name
panel_3 = Panel("union square nyc")

address_parser_3 = AddressParser()  # -> FormattedAdress, LatitudeLongitude

# ----
# Latitude ,Longitude to Statistic
coordinates2statistics = Coordinates2Statistics()  # -> Population_Density, Elevation, ElevationUnits, MeanTemperature, TemperatureUnits, Precipitation, PrecipitationUnits, Landcover, Sources, Notes
