# Grasshopper definition SampleFile v1.3.gh (Grasshopper 0.9.75)
# plug-ins: shpatit

# ----
# You can download FOOT PRINT.shp file for NYC here:
# 
# https://data.cityofnewyork.us/Housing-Development/Building-Footprints/tb92-6tj8
# 
# 
# 
# FOOT PRINT.shp file for San Francisco can be found here:
# 
# https://data.sfgov.org/Facilities-and-Structures/Building-Footprints-Zipped-Shapefile-Format-/jezr-5bxm
# Input .shp file path for
# the "FOOT PRINT"
foot_print = Panel("building_footprints_shape_09-13\building_0913.shp")

# ----
# You can download TAX PROPRTIES.shp file for NYC here:
# 
# http://www.nyc.gov/html/dcp/html/bytes/dwn_pluto_mappluto.shtml#mappluto
# Input .shp file path for
# the "TAX PROPERTIES"
tax_properties = Panel("MNMapPLUTO_13v1\MNMapPLUTO.shp")

# ----
# You can download POPULATION.shp file for NYC here:
# 
# (36061 is Manhattan or you can search for other Borough online-look at the name of the file we are using)
# 
# http://www2.census.gov/geo/pvs/36/
# Input .shp file path for
# the "POPULATION"
population = Panel("manhattan population\partnership_shapefiles_12v2_36061\PVS_12_v2_tabblock2010_36061.shp")

# ----
# SET TO TRUE #1
# Depending on how large the data set is, this component might take up to a few minutes to conver all the data to system.object
# This component is much faster and you can quickly review the existing attributes in the data set
toggle = BooleanToggle(False)
imp_it = ImpIt(Path=foot_print, Boolean=toggle)  # -> Objects, Features

# ----
# SET TO TRUE #1
# Depending on how large the data set is, this component might take up to a few minutes to conver all the data to system.object
# This component is much faster and you can quickly review the existing attributes in the data set
toggle_2 = BooleanToggle(False)
imp_it_2 = ImpIt(Path=tax_properties, Boolean=toggle_2)  # -> Objects, Features

# ----
# SET TO TRUE #1
# Depending on how large the data set is, this component might take up to a few minutes to conver all the data to system.object
# This component is much faster and you can quickly review the existing attributes in the data set
toggle_3 = BooleanToggle(False)
imp_it_3 = ImpIt(Path=population, Boolean=toggle_3)  # -> Objects, Features

# ----
# INPUT
feat_it = FeatIt()  # -> Type, Features
# INPUT
feat_it_2 = FeatIt()  # -> Type, Features
# INPUT
feat_it_3 = FeatIt()  # -> Type, Features
type_of_the_data_set = Panel(feat_it.Type)
existing_attributes_in_the_data_set = Panel(feat_it.Features)
existing_attributes_in_the_data_set_2 = Panel(imp_it.Features)
# SAMPLE_5
existing_attributes_in_the_data_set_3 = Panel(imp_it_2.Features)
existing_attributes_in_the_data_set_4 = Panel(feat_it_2.Features)
type_of_the_data_set_2 = Panel(feat_it_2.Type)
type_of_the_data_set_3 = Panel(feat_it_3.Type)
existing_attributes_in_the_data_set_5 = Panel(imp_it_3.Features)
existing_attributes_in_the_data_set_6 = Panel(feat_it_3.Features)

# ----
# SAMPLE_4
number_slider = Slider(6, range=0..20)
item = ListItem(List=imp_it_3.Features, Index=number_slider, Wrap=True)
panel = Panel(item)
datavis_it = DataVisIt(Shapes=imp_it_3.Objects, GetValueofFeature=panel, Boolean=Toggle(False))  # -> Polygon, Polyline, Point, AttValues
population_per_block = Panel(datavis_it.AttValues)
domain = Domain(datavis_it.AttValues)
bnd = Bounds(Numbers=flatten(domain))
dedomain = DeconstructDomain(Domain=bnd)  # -> Start, End
gradient = Gradient(
    LowerLimit=dedomain.End,
    UpperLimit=dedomain.Start,
    Parameter=datavis_it.AttValues,
    stops=[0.651: RGB(0, 38, 128), 0.806: RGB(255, 0, 0), 1: RGB(255, 229, 0), 1: RGB(255, 255, 194)])

# ----
# SAMPLE_3
# SET TO TRUE #4
toggle_4 = BooleanToggle(False)
datavis_it_2 = DataVisIt(Shapes=imp_it.Objects, GetValueofFeature=imp_it.Features, Boolean=toggle_4)  # -> Polygon, Polyline, Point, AttValues
panel_2 = Panel(datavis_it_2.AttValues)

# ----
# Input BIN
bin_s = Panel("1086164")

# ---- group: Some curves are not closed, reason for being orange
boundary = BoundarySurfaces(Edges=datavis_it.Polygon)

# ----
# Enable Preview_3
preview = CustomPreview(Geometry=boundary, Shader=gradient)

# ----
# DATA BINDING
# Input .shp file path for
# the "MAP PLUTO for MN"
# Input .shp file path for
# the "FOOT PRINT"
panel_3 = Panel("NYC datasets\mn_mappluto_13v1\MNMapPLUTO_13v1\MNMapPLUTO.shp")
panel_4 = Panel("NYC datasets\building_footprints_shape_09-13(1)\building_0913.shp")

# ----
# SET TO TRUE #1
# Depending on how large the data set is, this component might take up to a few minutes to conver all the data to gh shape object
toggle_5 = BooleanToggle(False)
# IMPORTANT NOTE FOR NYC: BBL(Borough Block Lot)
# BBL is a 10 digit number in NYC and it starts with the Borough number.
# 
# Manhattan Borough  #1
# Bronx  Borough  #2
# Brooklyn Borough  #3
# Queens Borough  #4
# Staten island Borough  #5
# 
# So we can filter through Boroughs in order to minimize our data. Here we can also look at BBL numbers below 20000000000 which would be all the BBLs in Manhattan.
toggle_6 = BooleanToggle(False)
imp_it_4 = ImpIt(Path=panel_3, Boolean=toggle_5)  # -> Shapes, Features
footprint_data_set = FootprintbyBorough(File_Path=panel_4, BoroughCode="1", Boolean=toggle_6)  # -> Shapes, Attributes

attribute_of_the_given_data_set = Panel(footprint_data_set.Attributes)
# SAMPLE_6
attributes_of_the_given_data_set = Panel(imp_it_4.Features)

# ---- group: LINK DATA SETS
# this component does the data binding !
data_bind = BindTwoShapefilesDatasets(Shapes_NYC_Taxmap=imp_it_4.Shapes, Shapes_NYC_BldgFootprint=footprint_data_set.Shapes)

# ----
# This is "NYCVis" component  for NYC Linked data.  In this case, it will output the Number of Floors  for only zipcode 10001
# sort the buildings only 6 floors and higher
# Select the item from feature list : ZipCode
# SET TO TRUE #2
# Select the item from feature list : NumFloors
# Select the item from feature list : BIN
item_2 = ListItem(List=imp_it_4.Features, Index=8, Wrap=True)
item_3 = ListItem(List=imp_it_4.Features, Index=41, Wrap=True)
item_4 = ListItem(List=footprint_data_set.Attributes, Index=0, Wrap=True)
panel_5 = Panel(item_4)
visualizelinkeddata = VisualizeLinkedData(Shapes=data_bind, Object_FilterByAtt=item_2, FilterAttValues="10001", GetAtt_Value=item_3, Trigger=Toggle(False))  # -> TaxProperty, Footprints, AttValues
visualizelinkeddata_2 = VisualizeLinkedData(Shapes=data_bind, Object_FilterByAtt=item_2, FilterAttValues="10001", GetAtt_Value=panel_5, Trigger=Toggle(False))  # -> TaxProperty, Footprints, AttValues
int = Integer(visualizelinkeddata.AttValues)
panel_6 = Panel(visualizelinkeddata.Footprints)
panel_7 = Panel(int)
panel_8 = Panel(visualizelinkeddata.TaxProperty)
panel_9 = Panel(visualizelinkeddata_2.AttValues)
larger = LargerThan(FirstNumber=int, SecondNumber="6")  # -> LargerThan, OrEqualTo
cull = CullPattern(List=visualizelinkeddata_2.AttValues, CullPattern=larger.OrEqualTo)
panel_10 = Panel(larger.OrEqualTo)
panel_11 = Panel(cull)
clean = CleanTree(Tree=cull, CleanInvalid=True, CleanEmpty=Toggle(True))
flatten = FlattenTree(Tree=clean, Path="{0}")
cset = CreateSet(List=flatten)  # -> Set, Map
bins_of_the_buildings_are_6_floors_or_hi = Panel(cset.Set)  # "BINs of the buildings are 6 floors or higher 10001"

# ----
# GeoCoder
# Type any address! this component return the true addesses & location (lat, long)
geocoder = GeoCoder()  # -> Formatted_Adress, Location
# street view , use the location output from address parser component
street_view = StreetView()

# ----
# SAMPLE_1
# SET TO TRUE #2
number_slider_2 = Slider(9, range=0..20)
# DATA QUERY + VISUALIZATION
number_slider_3 = Slider(1, range=0..20)
item_5 = ListItem(List=existing_attributes_in_the_data_set_2, Index=number_slider_2, Wrap=True)  # -> flatten(Item)
item_6 = ListItem(List=existing_attributes_in_the_data_set_2, Index=number_slider_3, Wrap=True)  # -> flatten(Item)
attribute_s = Panel(item_5)
attribute = Panel(item_6)

# ----
# Query for the data you are interested in. In this case we want to query for a specific building and it's height in order to create the geometry. You can query by BIN (Building Identification Number ).  [FltByFeat] input should be one item only. [FltByVal] can be a list. [GetValofFeat] will be the properties of the selected BIN.
datavis_it_3 = DataVisIt(
    Shapes=imp_it.Objects,
    FilterByFeat=attribute,
    FilterByFeatureValues=bin_s,
    GetValueofFeature=attribute_s,
    Boolean=Toggle(False))  # -> Polygon, Polyline, Point, AttValues

boundary_2 = BoundarySurfaces(Edges=datavis_it_3.Polygon)
building_height = Panel(datavis_it_3.AttValues)
panel_12 = Panel(datavis_it_3.Polygon)
preview_2 = CustomPreview(Geometry=boundary_2, Shader=ColourSwatch(SwatchColor=RGB(0, 201, 67)))
num = Number(building_height)
Z = UnitZ(Factor=num)

# ---- group: BUILDING TO BE ANALYZED
extr = Extrude(Base=boundary_2, Direction=Z)

# ----
# Enable Preview_1
# Enable Preview_3
preview_3 = CustomPreview(Geometry=datavis_it_2.Polygon, Shader=ColourSwatch(SwatchColor=RGB(125, 115, 115)))
preview_4 = CustomPreview(Geometry=extr, Shader=ColourSwatch(SwatchColor=RGBA(118, 240, 31, 234)))

# ----
# SAMPLE_2
# SET TO TRUE #3
panel_13 = Panel("""1
9""")
item_7 = ListItem(List=existing_attributes_in_the_data_set_2, Index=panel_13, Wrap=True)  # -> flatten(Item)
attribute_s_2 = Panel(item_7)
pcen = PolygonCenter(Polyline=datavis_it_3.Polygon)  # -> CenterV, CenterE, CenterA
distance_ft = Panel("200")

# ----
# You can use "DataVis" component this way as well. In this case, it will output the entire data. Therfore, depending on the size of data, it might be slow!
# 
# In this example we are visualizing all the 5 brough of NYC
datavis_it_4 = DataVisIt(Shapes=imp_it.Objects, GetValueofFeature=attribute_s_2, Boolean=Toggle(False))  # -> Polygon, Polyline, Point, AttValues
preview_5 = CustomPreview(Geometry=datavis_it_4.Polygon, Shader=ColourSwatch(SwatchColor=RGB(125, 115, 115)))

# ---- group: DO NOT ENABLE PREVIEW
# This might take all you
# memory if you are
# using a large data
pcen_2 = PolygonCenter(Polyline=datavis_it_4.Polygon)  # -> CenterV, CenterE, CenterA

# ----
dist = Distance(PointA=pcen.CenterA, PointB=pcen_2.CenterA)
smaller = SmallerThan(FirstNumber=dist, SecondNumber=distance_ft)  # -> SmallerThan, OrEqualTo
cull_2 = CullPattern(List=datavis_it_4.AttValues, CullPattern=smaller.SmallerThan)
cull_3 = CullPattern(List=datavis_it_4.Polygon, CullPattern=smaller.SmallerThan)

# ---- group: List of BINs
clean_2 = CleanTree(Tree=cull_2, CleanInvalid=True, CleanEmpty=True)  # -> simplify(Tree)

# ---- group: List of Polylines
clean_3 = CleanTree(Tree=cull_3, CleanInvalid=True, CleanEmpty=True)  # -> simplify(Tree)

# ----
bin_building_height = Panel(clean_2)
panel_14 = Panel(clean_3)
item_8 = ListItem(List=bin_building_height, Index=Slider(1, range=0..20), Wrap=True)
boundary_3 = BoundarySurfaces(Edges=clean_3)
num_2 = Number(item_8)
Z_2 = UnitZ(Factor=num_2)
pcen_3 = PolygonCenter(Polyline=clean_3)  # -> CenterV, CenterE, CenterA
item_9 = ListItem(List=bin_building_height, Index=Slider(0, range=0..20), Wrap=True)

# ---- group: BUILDING TO BE ANALYZED
extr_2 = Extrude(Base=boundary_3, Direction=Z_2)

# ----
# Enable Preview_2
tag = TextTag3D(Location=pcen_3.CenterA, Text=item_9, Size=Slider(5, range=0..20), Justification=7)
preview_6 = CustomPreview(Geometry=extr_2, Shader=ColourSwatch(SwatchColor=RGBA(66, 40, 181, 185)))
