# Grasshopper definition Ex_1_OSM3DBuildings.gh (Grasshopper 0.9.76)
# plug-ins: atit, HDTReference

addressparser = GeoCoderAddressParser(SearchAdress="union square nyc")  # -> Formatted_Adress, Location
num = Number("200")
nickname = Osm_bldgs(X_Range=num, Y_Range=num)  # -> Osm_3D_Bldgs, Osm_IDs, BuildingsColors
panel = Panel(nickname.BuildingsColors)

# ---- group: Better Visualization
number_slider = Slider(10, range=0..10)
wires = BrepWireframe(Brep=nickname.Osm_3D_Bldgs, Density=-1)
swatch = ColourSwatch(SwatchColor=RGB(206, 224, 255))
ext = ExtendCurve(Curve=wires, Type=0, Start=number_slider, End=number_slider)
preview = CustomPreview(Geometry=nickname.Osm_3D_Bldgs, Shader=nickname.BuildingsColors)
previewlw = CustomPreviewLineweights(Geometry=wires, Shader=ColourSwatch(SwatchColor=RGB(0, 0, 0)), Thickness=Slider(1, range=0..10))
