# Grasshopper definition Ex_2_OSM_Trace.gh (Grasshopper 0.9.76)
# plug-ins: atit

number_slider = Slider(200, range=0..1000)
addressparser = GeoCoderAddressParser(SearchAdress="union square nyc")  # -> Formatted_Adress, flatten(Location)
panel = Panel(addressparser.Location)
osm_trace = Osm_Trace(Location=addressparser.Location, X_Range=number_slider, Y_Range=number_slider, UTMLatLong=True)  # -> Osm_IDs, IsOsm_Bldg, Osm_Trace, KeyValue
panel_2 = Panel(osm_trace.Osm_IDs)
panel_3 = Panel(osm_trace.IsOsm_Bldg)
cull = CullPattern(List=osm_trace.Osm_IDs, CullPattern=osm_trace.IsOsm_Bldg)
panel_4 = Panel(cull)
item = ListItem(List=cull, Index=Slider(108, range=1..219), Wrap=True)
panel_5 = Panel(item)
osm_bldginfo = Osm_bldgInfo(Osm_Bldg_ID=item)  # -> Building, BuildingPart, BuildingUse, BuildingLevels, BuildingMin_level, BuildingMaterial, BuildingColor, Height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
panel_6 = Panel("158413988")
panel_7 = Panel(osm_bldginfo.GeoJson)
